# Grasshopper definition Example 1 - Offset complex polygon.gh (Grasshopper 0.9.75)
# plug-ins: ClipperComponents

# Example 1: A Complex (Self intersecting polygon)
panel = Panel("{10,20,0}")
amount_of_offsets = Slider(9, range=0..100)
kaleidoscope = Kaleidoscope(Geometry=panel, Plane=PlaneXY(0, 0, 0), Segments=10)  # -> Geometry, Transform
series = Series(Start=0, Step=0.9, Count=amount_of_offsets)
miter_distance = Slider(0, range=0..1000)
closed_fillet_type = ValueList({"Round": 0, "Square": 1, "Miter": 2}, selected="Miter")
polyline = PolyLine(Vertices=kaleidoscope.Geometry, Closed=True)
open_fillet_type = ValueList({"Round": 0, "Square": 1, "Butt": 2}, selected="Butt")
polygon_offset = PolygonOffset(
    Polylines=polyline,
    Distance=series,
    Plane=Plane(origin=(0, 0, 0), x=(0, 0, 0), y=(0, 0, 0)),
    Tolerance=0.01,
    ClosedFillet=closed_fillet_type,
    OpenFillet=open_fillet_type,
    Miter=miter_distance)  # -> Contour, Holes
curve = Curve(polygon_offset.Holes)
curve_2 = Curve(polygon_offset.Contour)
